# Grasshopper definition phius_rv2024_simulate_ADORB.gh (Grasshopper 1.0.8)

# ----
# Source and Target Files / Folders
config = HBConfig()  # -> python_exe, py_lib_install, rad_install, os_install, ep_install, hb_os_gem, standards, asset_report, default_sim; plug-in component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
ghpython_script = GhPythonScript()  # -> out, root_folder, source_weather_folder, hbrv_weather_folder, hbrv_source_model, hbrv_simulation_save_folder, phius_gui_idf
# ---------- ghpython_script: Python ----------
import os 
import rhinoscriptsyntax as rs

root_folder_ = rs.DocumentPath()
source_weather_folder_ = os.path.join(root_folder_, "_source_weather")

adorb_folder_ = os.path.join(root_folder_, "adorb")

hbrv_weather_folder_ = os.path.join(adorb_folder_, "hbrv_generated_weather")
hbrv_source_model_ = os.path.join(root_folder_, "_source_models", "phius_rv2024_model.hbjson")
hbrv_simulation_save_folder_ = os.path.join(root_folder_, "adorb", "hbrv")

phius_gui_idf_ = os.path.join(adorb_folder_, "phius_gui")
# ---------- end ghpython_script ----------
ghpython_script_2 = GhPythonScript(hb_py_lib_install=config.py_lib_install)  # -> out, measure
# ---------- ghpython_script_2: Python ----------
import os 


measure_ = os.path.join(_hb_py_lib_install, "honeybee_revive_measures", "set_revive_people_eplus/")
# ---------- end ghpython_script_2 ----------
hb_rv_save_folder = Panel(ghpython_script.hbrv_simulation_save_folder)
weather_save_folder = Panel(ghpython_script.hbrv_weather_folder)
measure_folder = Panel(ghpython_script_2.measure)
weather_save_folder_2 = Panel(ghpython_script.source_weather_folder)
hbjson_source_model = Panel(ghpython_script.hbrv_source_model)
hb_rv_save_folder_2 = Panel(ghpython_script.phius_gui_idf)

# ----
# Phius REVIVE 2024 Test Model
boolean_toggle = BooleanToggle(True)
loadobjects = HBLoadObjects(hb_file=hbjson_source_model, load=boolean_toggle)  # -> out, hb_objs; plug-in component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
ghpython_script_3 = GhPythonScript(model=loadobjects.hb_objs)  # -> out, rooms, shades
# ---------- ghpython_script_3: Python ----------
rooms_ = _model.rooms
shades_ = _model.shades
# ---------- end ghpython_script_3 ----------

# ----
# REVIVE | HVAC
panel = Panel("GasFurnaceDXAC")
create_revive_hvac_equipment_properties = HBREVIVECreateREVIVEHVACEquipmentProperties(name=panel, cost="7500", labor_fraction="0.4", lifetime_years="20")  # -> out, hvac_equipment_properties; inputs lifetime_years: Int32
# ---------- create_revive_hvac_equipment_properties: Python ----------
#
# Honeybee-REVIVE: A Plugin for calculating Phius REVIVE using LadybugTools Honeybee-Energy Models
# 
# This component is part of the PH-Tools toolkit <https://github.com/PH-Tools>.
# 
# Copyright (c) 2024, PH-Tools and bldgtyp, llc <phtools@bldgtyp.com> 
# Honeybee-REVIVE is free software; you can redistribute it and/or modify 
# it under the terms of the GNU General Public License as published 
# by the Free Software Foundation; either version 3 of the License, 
# or (at your option) any later version. 
# 
# Honeybee-REVIVE is distributed in the hope that it will be useful,
# but WITHOUT ANY WARRANTY; without even the implied warranty of 
# MERCHANTABILITY or FITNESS FOR A PARTICULAR PURPOSE. See the 
# GNU General Public License for more details.
# 
# For a copy of the GNU General Public License
# see <https://github.com/PH-Tools/honeybee_revive/blob/main/LICENSE>.
# 
# @license GPL-3.0+ <http://spdx.org/licenses/GPL-3.0+>
#
"""
Create a new Phius-REVIVE-HVAC-Equipment-Properties item which can be added to a Honeybee-Room.
Note that this equipment is ONLY for keeping track of the relevant Phius-REVIVE
properties and does NOT add any actual equipment to the Honeybee-Rooms. Use the normal 
Honeybee-Energy components to configure the actual equipment objects on the roonms.
-
EM October 1, 2024
    Args:
        _name: (str) A name for the piece of REVIVE-HVAC-Equipment-Properties.

        _cost: (float) The total purchase-cost of the Appliance.

        _labor_fraction: (float) A number between 0 and 1.0 representing the percentage
            of the appliance cost related to labor, as opposed to material. 

        _lifetime_years: (float) The total number of years the appliance will last
            before it needs to be completely replaced. 

    Returns:
        hvac_equipment_properties_: (Process) The Honeybee-REVIVE-HVAC-Properties which can be added
            a Honeybee-Room.
"""

import scriptcontext as sc
import Rhino as rh
import rhinoscriptsyntax as rs
import ghpythonlib.components as ghc
import Grasshopper as gh

try:
    from ph_gh_component_io import gh_io
except ImportError as e:
    raise ImportError('\nFailed to import ph_gh_component_io:\n\t{}'.format(e))

try:
    from honeybee_revive_rhino import gh_compo_io
except ImportError as e:
    raise ImportError('\nFailed to import honeybee_revive_rhino:\n\t{}'.format(e))


# ------------------------------------------------------------------------------
import honeybee_revive_rhino._component_info_
reload(honeybee_revive_rhino._component_info_)
ghenv.Component.Name = "HB-REVIVE - Create REVIVE HVAC Equipment Properties"
DEV = honeybee_revive_rhino._component_info_.set_component_params(ghenv, dev=False)
if DEV:
    from honeybee_revive_rhino.gh_compo_io.equipment import hvac_create_properties as gh_compo_io
    reload(gh_compo_io)
    
# ------------------------------------------------------------------------------
# -- GH Interface
IGH = gh_io.IGH( ghdoc, ghenv, sc, rh, rs, ghc, gh )

# ------------------------------------------------------------------------------
gh_compo_interface = gh_compo_io.GHCompo_CreateReviveHvacEquipmentProperties(
        IGH,
        _name,
        _cost,
        _labor_fraction,
        _lifetime_years,
)
hvac_equipment_properties_ = gh_compo_interface.run()
print hvac_equipment_properties_
# ---------- end create_revive_hvac_equipment_properties ----------
add_revive_hvac_equipment_properties_to = HBREVIVEAddREVIVEHVACEquipmentPropertiesToRooms(
    equipment_properties=flatten(create_revive_hvac_equipment_properties.hvac_equipment_properties),
    hb_rooms=flatten(ghpython_script_3.rooms))  # -> out, hb_rooms; "Add REVIVE HVAC Equipment Properties to Rooms"; inputs equipment_properties: list, hb_rooms: list
# ---------- add_revive_hvac_equipment_properties_to: Python ----------
#
# Honeybee-REVIVE: A Plugin for calculating Phius REVIVE using LadybugTools Honeybee-Energy Models
# 
# This component is part of the PH-Tools toolkit <https://github.com/PH-Tools>.
# 
# Copyright (c) 2024, PH-Tools and bldgtyp, llc <phtools@bldgtyp.com> 
# Honeybee-REVIVE is free software; you can redistribute it and/or modify 
# it under the terms of the GNU General Public License as published 
# by the Free Software Foundation; either version 3 of the License, 
# or (at your option) any later version. 
# 
# Honeybee-REVIVE is distributed in the hope that it will be useful,
# but WITHOUT ANY WARRANTY; without even the implied warranty of 
# MERCHANTABILITY or FITNESS FOR A PARTICULAR PURPOSE. See the 
# GNU General Public License for more details.
# 
# For a copy of the GNU General Public License
# see <https://github.com/PH-Tools/honeybee_revive/blob/main/LICENSE>.
# 
# @license GPL-3.0+ <http://spdx.org/licenses/GPL-3.0+>
#
"""
Add Phius-REVIVE-HVAC-Equipment-Properties onto Honeybee-Rooms.
-
EM October 1, 2024
    Args:
        _equipment_properties: (list[]) The new Phius-REVIVE-HVAC-Equiment-Properties
            to add to the Honeybee-Rooms.

        _hb_rooms: (list[Room]) The Honeybee-Rooms to add the new Phius-REVIVE
            HVAC-Properties to.

    Returns:
        hb_rooms_: (list[Room]) The Honeybee-Rooms with the Phius-REVIVE HVAC
            Equipment Properties added. 
"""

import scriptcontext as sc
import Rhino as rh
import rhinoscriptsyntax as rs
import ghpythonlib.components as ghc
import Grasshopper as gh

try:
    from ph_gh_component_io import gh_io
except ImportError as e:
    raise ImportError('\nFailed to import ph_gh_component_io:\n\t{}'.format(e))

try:
    from honeybee_revive_rhino import gh_compo_io
except ImportError as e:
    raise ImportError('\nFailed to import honeybee_revive_rhino:\n\t{}'.format(e))


# ------------------------------------------------------------------------------
import honeybee_revive_rhino._component_info_
reload(honeybee_revive_rhino._component_info_)
ghenv.Component.Name = "HB-REVIVE - Add REVIVE HVAC Equipment Properties to Rooms"
DEV = honeybee_revive_rhino._component_info_.set_component_params(ghenv, dev=False)
if DEV:
    from honeybee_revive_rhino.gh_compo_io.equipment import hvac_add_properties_to_room as gh_compo_io
    reload(gh_compo_io)
    
# ------------------------------------------------------------------------------
# -- GH Interface
IGH = gh_io.IGH( ghdoc, ghenv, sc, rh, rs, ghc, gh )

# ------------------------------------------------------------------------------
gh_compo_interface = gh_compo_io.GHCompo_AddHvacEquipmentPropertiesToRooms(
        IGH,
        _equipment_properties,
        _hb_rooms,
)
hb_rooms_ = gh_compo_interface.run()
print hb_rooms_
# ---------- end add_revive_hvac_equipment_properties_to ----------

# ----
# REVIVE | Appliances
panel_2 = Panel("1")
constantschedule = HBConstantSchedule(values=panel_2)  # -> out, schedule, idf_text; plug-in component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
panel_3 = Panel("""Fridge_360W
Clotheswasher_160W
Clothesdryer_704W
Dishwasher_360W""")
create_revive_appliance = HBREVIVECreateREVIVEAppliance(
    name="Range_0W",
    watts="0",
    schedule=constantschedule.schedule,
    fuel_type="Electricity",
    use_category="Range",
    radiant_fract="0.4",
    latent_fract="0.3")  # -> out, appliance
# ---------- create_revive_appliance: Python ----------
#
# Honeybee-REVIVE: A Plugin for calculating Phius REVIVE using LadybugTools Honeybee-Energy Models
# 
# This component is part of the PH-Tools toolkit <https://github.com/PH-Tools>.
# 
# Copyright (c) 2024, PH-Tools and bldgtyp, llc <phtools@bldgtyp.com> 
# Honeybee-REVIVE is free software; you can redistribute it and/or modify 
# it under the terms of the GNU General Public License as published 
# by the Free Software Foundation; either version 3 of the License, 
# or (at your option) any later version. 
# 
# Honeybee-REVIVE is distributed in the hope that it will be useful,
# but WITHOUT ANY WARRANTY; without even the implied warranty of 
# MERCHANTABILITY or FITNESS FOR A PARTICULAR PURPOSE. See the 
# GNU General Public License for more details.
# 
# For a copy of the GNU General Public License
# see <https://github.com/PH-Tools/honeybee_revive/blob/main/LICENSE>.
# 
# @license GPL-3.0+ <http://spdx.org/licenses/GPL-3.0+>
#
"""
Create a new Honeybee-REVIVE Appliance which can be added to one or more Honeybee-Rooms.
-
EM October 1, 2024
    Args:
        _name_: (str) Text to set the name for the Appliance and to be incorporated into a
            unique Appliance identifier. If None, a unique name will be
            generated.
        
        _watts: (float) A number for the process load power in Watts.
        
        _schedule: A fractional schedule for the use of the process over the course of
            the year. The fractional values will get multiplied by the _watts
            to yield a complete process load profile.
        
        _fuel_type: (str) Text to denote the type of fuel consumed by the Appliance. Using the
            "None" type indicates that no end uses will be associated with the
            Appliance, only the zone gains. Choose from the following.
                * Electricity
                * NaturalGas
                * Propane
                * FuelOilNo1
                * FuelOilNo2
                * Diesel
                * Gasoline
                * Coal
                * Steam
                * DistrictHeating
                * DistrictCooling
                * OtherFuel1
                * OtherFuel2
                * None
        
        use_category_: Text to indicate the end-use subcategory, which will identify
            the appliance load in the EUI output. For example, “Cooking”,
            “Clothes Drying”, etc. (Default: General).
        
        radiant_fract_: A number between 0 and 1 for the fraction of the total
            appliance load given off as long wave radiant heat. (Default: 0).
        
        latent_fract_: A number between 0 and 1 for the fraction of the total
            appliance load that is latent (as opposed to sensible). (Default: 0).
        
        lost_fract_: A number between 0 and 1 for the fraction of the total
            appliance load that is lost outside of the zone and the HVAC system.
            Typically, this is used to represent heat that is exhausted directly
            out of a zone (as you would for a stove). (Default: 0).

    Returns:
        appliance_: (Process) The new Honeybee-REVIVE Appliance which can be added
            to one or more Honeybee-Rooms.
"""

import scriptcontext as sc
import Rhino as rh
import rhinoscriptsyntax as rs
import ghpythonlib.components as ghc
import Grasshopper as gh

try:
    from ph_gh_component_io import gh_io
except ImportError as e:
    raise ImportError('\nFailed to import ph_gh_component_io:\n\t{}'.format(e))

try:
    from honeybee_revive_rhino import gh_compo_io
except ImportError as e:
    raise ImportError('\nFailed to import honeybee_revive_rhino:\n\t{}'.format(e))


# ------------------------------------------------------------------------------
import honeybee_revive_rhino._component_info_
reload(honeybee_revive_rhino._component_info_)
ghenv.Component.Name = "HB-REVIVE - Create REVIVE Appliance"
DEV = honeybee_revive_rhino._component_info_.set_component_params(ghenv, dev=False)
if DEV:
    from honeybee_revive_rhino.gh_compo_io.equipment import appliances_create as gh_compo_io
    reload(gh_compo_io)
    
# ------------------------------------------------------------------------------
# -- GH Interface
IGH = gh_io.IGH( ghdoc, ghenv, sc, rh, rs, ghc, gh )

# ------------------------------------------------------------------------------
gh_compo_interface = gh_compo_io.GHCompo_CreateReviveAppliance(
        IGH,
        _name_,
        _watts,
        _schedule,
        _fuel_type,
        use_category_,
        radiant_fract_,
        latent_fract_,
        lost_fract_,
)
appliance_ = gh_compo_interface.run()
print appliance_
# ---------- end create_revive_appliance ----------
load_revive_appliance_from_standards_lib = HBREVIVELoadREVIVEApplianceFromStandardsLibrary(appliance_names=panel_3)  # -> out, appliances; "Load REVIVE Appliance from Standards Library"; inputs appliance_names: list
# ---------- load_revive_appliance_from_standards_lib: Python ----------
#
# Honeybee-REVIVE: A Plugin for calculating Phius REVIVE using LadybugTools Honeybee-Energy Models
# 
# This component is part of the PH-Tools toolkit <https://github.com/PH-Tools>.
# 
# Copyright (c) 2024, PH-Tools and bldgtyp, llc <phtools@bldgtyp.com> 
# Honeybee-REVIVE is free software; you can redistribute it and/or modify 
# it under the terms of the GNU General Public License as published 
# by the Free Software Foundation; either version 3 of the License, 
# or (at your option) any later version. 
# 
# Honeybee-REVIVE is distributed in the hope that it will be useful,
# but WITHOUT ANY WARRANTY; without even the implied warranty of 
# MERCHANTABILITY or FITNESS FOR A PARTICULAR PURPOSE. See the 
# GNU General Public License for more details.
# 
# For a copy of the GNU General Public License
# see <https://github.com/PH-Tools/honeybee_revive/blob/main/LICENSE>.
# 
# @license GPL-3.0+ <http://spdx.org/licenses/GPL-3.0+>
#
"""
Load one or more Hoenybee-REVIVE Appliances from the Standards Library.
-
EM October 1, 2024
    Args:
        _appliance_names: (list[str]) The name or names to search the Honeybee-REVIVE
            standards library for.

    Returns:
        appliances_: (list[Process]) The Honeybee-REVIVE Appliances found.
"""

import scriptcontext as sc
import Rhino as rh
import rhinoscriptsyntax as rs
import ghpythonlib.components as ghc
import Grasshopper as gh

try:
    from ph_gh_component_io import gh_io
except ImportError as e:
    raise ImportError('\nFailed to import ph_gh_component_io:\n\t{}'.format(e))

try:
    from honeybee_revive_rhino import gh_compo_io
except ImportError as e:
    raise ImportError('\nFailed to import honeybee_revive_rhino:\n\t{}'.format(e))


# ------------------------------------------------------------------------------
import honeybee_revive_rhino._component_info_
reload(honeybee_revive_rhino._component_info_)
ghenv.Component.Name = "HB-REVIVE - Load REVIVE Appliance from Standards Library"
DEV = honeybee_revive_rhino._component_info_.set_component_params(ghenv, dev=False)
if DEV:
    from honeybee_revive_rhino.gh_compo_io.standards import load_appliance_from_standards as gh_compo_io
    reload(gh_compo_io)
    
# ------------------------------------------------------------------------------
# -- GH Interface
IGH = gh_io.IGH( ghdoc, ghenv, sc, rh, rs, ghc, gh )

# ------------------------------------------------------------------------------
gh_compo_interface = gh_compo_io.GHCompo_LoadReviveApplianceFromStandardsLibrary(
        IGH,
        _appliance_names
)
appliances_ = gh_compo_interface.run()
for a in appliances_:
    print(a)
# ---------- end load_revive_appliance_from_standards_lib ----------
set_revive_appliance_properties = HBREVIVESetREVIVEApplianceProperties(cost="992", labor_fraction="0.1", lifetime_years="13", appliance=create_revive_appliance.appliance)  # -> out, appliance
# ---------- set_revive_appliance_properties: Python ----------
#
# Honeybee-REVIVE: A Plugin for calculating Phius REVIVE using LadybugTools Honeybee-Energy Models
# 
# This component is part of the PH-Tools toolkit <https://github.com/PH-Tools>.
# 
# Copyright (c) 2024, PH-Tools and bldgtyp, llc <phtools@bldgtyp.com> 
# Honeybee-REVIVE is free software; you can redistribute it and/or modify 
# it under the terms of the GNU General Public License as published 
# by the Free Software Foundation; either version 3 of the License, 
# or (at your option) any later version. 
# 
# Honeybee-REVIVE is distributed in the hope that it will be useful,
# but WITHOUT ANY WARRANTY; without even the implied warranty of 
# MERCHANTABILITY or FITNESS FOR A PARTICULAR PURPOSE. See the 
# GNU General Public License for more details.
# 
# For a copy of the GNU General Public License
# see <https://github.com/PH-Tools/honeybee_revive/blob/main/LICENSE>.
# 
# @license GPL-3.0+ <http://spdx.org/licenses/GPL-3.0+>
#
"""
Set the Honeybee-REVIVE properties on a Honeybee-REVIVE Appliance.
-
EM October 1, 2024
    Args:
        _cost: (float) The total purchase-cost of the Appliance.

        _labor_fraction: (float) A number between 0 and 1.0 representing the percentage
            of the appliance cost related to labor, as opposed to material. 

        _lifetime_years: (float) The total number of years the appliance will last
            before it needs to be completely replaced. 

        _appliance: (Process) The Hoenybee-REVIVE Appliance to set the properties on.

    Returns:
        appliance_: (Process) The Honeybee-REVIVE Appliance with the properties set.
"""

import scriptcontext as sc
import Rhino as rh
import rhinoscriptsyntax as rs
import ghpythonlib.components as ghc
import Grasshopper as gh

try:
    from ph_gh_component_io import gh_io
except ImportError as e:
    raise ImportError('\nFailed to import ph_gh_component_io:\n\t{}'.format(e))

try:
    from honeybee_revive_rhino import gh_compo_io
except ImportError as e:
    raise ImportError('\nFailed to import honeybee_revive_rhino:\n\t{}'.format(e))


# ------------------------------------------------------------------------------
import honeybee_revive_rhino._component_info_
reload(honeybee_revive_rhino._component_info_)
ghenv.Component.Name = "HB-REVIVE - Set REVIVE Appliance Properties"
DEV = honeybee_revive_rhino._component_info_.set_component_params(ghenv, dev=False)
if DEV:
    from honeybee_revive_rhino.gh_compo_io.equipment import appliances_set_revive_properties as gh_compo_io
    reload(gh_compo_io)
    
# ------------------------------------------------------------------------------
# -- GH Interface
IGH = gh_io.IGH( ghdoc, ghenv, sc, rh, rs, ghc, gh )

# ------------------------------------------------------------------------------
gh_compo_interface = gh_compo_io.GHCompo_SetApplianceReviveProperties(
        IGH,
        _cost,
        _labor_fraction,
        _lifetime_years,
        _appliance,
)
appliance_ = gh_compo_interface.run()
print appliance_
# ---------- end set_revive_appliance_properties ----------
merge = Merge(Data1=set_revive_appliance_properties.appliance, Data2=load_revive_appliance_from_standards_lib.appliances)
add_revive_appliances_to_rooms = HBREVIVEAddREVIVEAppliancesToRooms(appliances=merge, hb_rooms=add_revive_hvac_equipment_properties_to.hb_rooms)  # -> out, hb_rooms; inputs appliances: list, hb_rooms: list
# ---------- add_revive_appliances_to_rooms: Python ----------
#
# Honeybee-REVIVE: A Plugin for calculating Phius REVIVE using LadybugTools Honeybee-Energy Models
# 
# This component is part of the PH-Tools toolkit <https://github.com/PH-Tools>.
# 
# Copyright (c) 2024, PH-Tools and bldgtyp, llc <phtools@bldgtyp.com> 
# Honeybee-REVIVE is free software; you can redistribute it and/or modify 
# it under the terms of the GNU General Public License as published 
# by the Free Software Foundation; either version 3 of the License, 
# or (at your option) any later version. 
# 
# Honeybee-REVIVE is distributed in the hope that it will be useful,
# but WITHOUT ANY WARRANTY; without even the implied warranty of 
# MERCHANTABILITY or FITNESS FOR A PARTICULAR PURPOSE. See the 
# GNU General Public License for more details.
# 
# For a copy of the GNU General Public License
# see <https://github.com/PH-Tools/honeybee_revive/blob/main/LICENSE>.
# 
# @license GPL-3.0+ <http://spdx.org/licenses/GPL-3.0+>
#
"""
Add one or more Honeybee-REVIVE Appliances to a group of Honeybee-Rooms. 
NOTE that ALL of the appliances will be added to ALL of the rooms. So you 
may want to break out the rooms and assign the appliances separately (for instance
if you are assigning a Cooktop, be sure that this gets assigned only to one room.)
-
EM October 1, 2024
    Args:
        _appliances: (list[Process]) The appliances to add to each of the 
            Honeybee-Rooms

        _hb_rooms: (list[Room]) The Honeybee-Rooms to have the appliances added.

    Returns:
        hb_rooms_: (list[Room]) The Honeybee-Rooms with the Appliances added. 
"""

import scriptcontext as sc
import Rhino as rh
import rhinoscriptsyntax as rs
import ghpythonlib.components as ghc
import Grasshopper as gh

try:
    from ph_gh_component_io import gh_io
except ImportError as e:
    raise ImportError('\nFailed to import ph_gh_component_io:\n\t{}'.format(e))

try:
    from honeybee_revive_rhino import gh_compo_io
except ImportError as e:
    raise ImportError('\nFailed to import honeybee_revive_rhino:\n\t{}'.format(e))


# ------------------------------------------------------------------------------
import honeybee_revive_rhino._component_info_
reload(honeybee_revive_rhino._component_info_)
ghenv.Component.Name = "HB-REVIVE - Add REVIVE Appliances to Rooms"
DEV = honeybee_revive_rhino._component_info_.set_component_params(ghenv, dev=False)
if DEV:
    from honeybee_revive_rhino.gh_compo_io.equipment import appliances_add_to_room as gh_compo_io
    reload(gh_compo_io)
    
# ------------------------------------------------------------------------------
# -- GH Interface
IGH = gh_io.IGH( ghdoc, ghenv, sc, rh, rs, ghc, gh )

# ------------------------------------------------------------------------------
gh_compo_interface = gh_compo_io.GHCompo_AddReviveAppliancesToRooms(
        IGH,
        _appliances,
        _hb_rooms,
)
hb_rooms_ = gh_compo_interface.run()
# ---------- end add_revive_appliances_to_rooms ----------

# ---- group: Rooftop PV
# REVIVE | Shading & PV
# Until Chris merges the PR, this won’t work.
cluster = Cluster(hb_objs=add_revive_appliances_to_rooms.hb_rooms)
shade = HBShade(geo=cluster)  # -> out, shades; plug-in component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
photovoltaic = HBPhotovoltaicProperties(shades=shade.shades)  # -> out, shades; plug-in component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
set_revive_pv_shade_properties = HBREVIVESetREVIVEPVShadeProperties(cost="5", labor_fraction="0.25", lifetime_years="25", hb_shades=photovoltaic.shades)  # -> out, hb_shades; inputs lifetime_years: Int32, hb_shades: list
# ---------- set_revive_pv_shade_properties: Python ----------
#
# Honeybee-REVIVE: A Plugin for calculating Phius REVIVE using LadybugTools Honeybee-Energy Models
# 
# This component is part of the PH-Tools toolkit <https://github.com/PH-Tools>.
# 
# Copyright (c) 2024, PH-Tools and bldgtyp, llc <phtools@bldgtyp.com> 
# Honeybee-REVIVE is free software; you can redistribute it and/or modify 
# it under the terms of the GNU General Public License as published 
# by the Free Software Foundation; either version 3 of the License, 
# or (at your option) any later version. 
# 
# Honeybee-REVIVE is distributed in the hope that it will be useful,
# but WITHOUT ANY WARRANTY; without even the implied warranty of 
# MERCHANTABILITY or FITNESS FOR A PARTICULAR PURPOSE. See the 
# GNU General Public License for more details.
# 
# For a copy of the GNU General Public License
# see <https://github.com/PH-Tools/honeybee_revive/blob/main/LICENSE>.
# 
# @license GPL-3.0+ <http://spdx.org/licenses/GPL-3.0+>
#
"""
Add Phius-REVIVE properties to one or more Honeybee-Shade objects which have 
PV (Photovoltaic) panels on them. Note that you should use the Honeybee-Energy
'HB Photovoltaic Properties' component to set up the basic PV panel attributes
FIRST before using this componet to set the Phius-REVIVE properties.
-
EM October 1, 2024
    Args:
        _cost: (float) The total cost of the PV

        _labor_fraction: (float) The fraction of the PV cost associated with labor,
            as opposed to material.

        _lifetime_years: (float) The lifetime (in years) of the PV

        _hb_shades: (list[Shade]) A list of Honeybee-Energy Shade objects which 
            have PV-Modules added to them.

    Returns:
        hb_shades_: (list[Shade]) The Honeybee-Energy-Shade objects with their 
            Phius-REVIVE properties set. These Shades can be added to a Honeybee-Model.
"""

import scriptcontext as sc
import Rhino as rh
import rhinoscriptsyntax as rs
import ghpythonlib.components as ghc
import Grasshopper as gh

try:
    from ph_gh_component_io import gh_io
except ImportError as e:
    raise ImportError('\nFailed to import ph_gh_component_io:\n\t{}'.format(e))

try:
    from honeybee_revive_rhino import gh_compo_io
except ImportError as e:
    raise ImportError('\nFailed to import honeybee_revive_rhino:\n\t{}'.format(e))


# ------------------------------------------------------------------------------
import honeybee_revive_rhino._component_info_
reload(honeybee_revive_rhino._component_info_)
ghenv.Component.Name = "HB-REVIVE - Set REVIVE PV-Shade Properties"
DEV = honeybee_revive_rhino._component_info_.set_component_params(ghenv, dev=False)
if DEV:
    from honeybee_revive_rhino.gh_compo_io.equipment import pv_set_shade_properties as gh_compo_io
    reload(gh_compo_io)
    
# ------------------------------------------------------------------------------
# -- GH Interface
IGH = gh_io.IGH( ghdoc, ghenv, sc, rh, rs, ghc, gh )

# ------------------------------------------------------------------------------
gh_compo_interface = gh_compo_io.GHCompo_SetPvShadeProperties(
        IGH,
        _cost,
        _labor_fraction,
        _lifetime_years,
        _hb_shades,
)
hb_shades_ = gh_compo_interface.run()
# ---------- end set_revive_pv_shade_properties ----------

# ----
merge_2 = Merge(Data1=ghpython_script_3.shades, Data2=set_revive_pv_shade_properties.hb_shades)
flatten_tree = FlattenTree(Tree=merge_2, Path="{0}")

model = HBModel(rooms=flatten(add_revive_appliances_to_rooms.hb_rooms), shades=flatten(flatten_tree), name="hb_revive_ADORB_model")  # -> out, model; plug-in component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

# ----
# REVIVE | CO2 Measures
panel_4 = Panel("""HP Replace 1
HP Replace 2""")
value_list = ValueList({"PERFORMANCE": "1-PERFORMANCE", "NON-PERFORMANCE": "2-NON_PERFORMANCE"}, selected="PERFORMANCE")
load_revive_co2_measures_from_standards = HBREVIVELoadREVIVECO2MeasuresFromStandardsLibrary(measure_names=panel_4)  # -> out, measures; "Load REVIVE CO2-Measures from Standards Library"; inputs measure_names: list
#   port measure_names: (str) The name of the Measure to search the Standards library for.
# ---------- load_revive_co2_measures_from_standards: Python ----------
#
# Honeybee-REVIVE: A Plugin for calculating Phius REVIVE using LadybugTools Honeybee-Energy Models
# 
# This component is part of the PH-Tools toolkit <https://github.com/PH-Tools>.
# 
# Copyright (c) 2024, PH-Tools and bldgtyp, llc <phtools@bldgtyp.com> 
# Honeybee-REVIVE is free software; you can redistribute it and/or modify 
# it under the terms of the GNU General Public License as published 
# by the Free Software Foundation; either version 3 of the License, 
# or (at your option) any later version. 
# 
# Honeybee-REVIVE is distributed in the hope that it will be useful,
# but WITHOUT ANY WARRANTY; without even the implied warranty of 
# MERCHANTABILITY or FITNESS FOR A PARTICULAR PURPOSE. See the 
# GNU General Public License for more details.
# 
# For a copy of the GNU General Public License
# see <https://github.com/PH-Tools/honeybee_revive/blob/main/LICENSE>.
# 
# @license GPL-3.0+ <http://spdx.org/licenses/GPL-3.0+>
#
"""
Load a CO2-Reduction-Measure from the Honeybee-REVIVE Standards Library.
-
EM OCtober 1, 2024
    Args:
        _measuere_names: (list[str]) The name or names of the Measures to search the 
            Standards library for.

    Returns:
        measures_: (list[CO2ReductionMeasure]) The Measures, if found.
"""

import scriptcontext as sc
import Rhino as rh
import rhinoscriptsyntax as rs
import ghpythonlib.components as ghc
import Grasshopper as gh

try:
    from ph_gh_component_io import gh_io
except ImportError as e:
    raise ImportError('\nFailed to import ph_gh_component_io:\n\t{}'.format(e))

try:
    from honeybee_revive_rhino import gh_compo_io
except ImportError as e:
    raise ImportError('\nFailed to import honeybee_revive_rhino:\n\t{}'.format(e))


# ------------------------------------------------------------------------------
import honeybee_revive_rhino._component_info_
reload(honeybee_revive_rhino._component_info_)

ghenv.Component.Name = "HB-REVIVE - Load REVIVE CO2-Measures from Standards Library"
DEV = honeybee_revive_rhino._component_info_.set_component_params(ghenv, dev=False)
if DEV:
    from honeybee_revive_rhino.gh_compo_io.standards import load_CO2_measure_from_standards as gh_compo_io
    reload(gh_compo_io)

# ------------------------------------------------------------------------------
# -- GH Interface
IGH = gh_io.IGH( ghdoc, ghenv, sc, rh, rs, ghc, gh )

# ------------------------------------------------------------------------------
gh_compo_interface = gh_compo_io.GHCompo_LoadCO2ReductionMeasure(
        IGH,
        _measure_names,
)
measures_ = gh_compo_interface.run()
for m in measures_:
    print(m)
# ---------- end load_revive_co2_measures_from_standards ----------
create_co2_reduction_measure = HBREVIVECreateCO2ReductionMeasure(name="HP Replace 3", measure_type=value_list, year="60", cost="8500", country_name="USA", labor_fraction="0.4")  # -> out, measure; inputs year: Int32
# ---------- create_co2_reduction_measure: Python ----------
#
# Honeybee-REVIVE: A Plugin for calculating Phius REVIVE using LadybugTools Honeybee-Energy Models
# 
# This component is part of the PH-Tools toolkit <https://github.com/PH-Tools>.
# 
# Copyright (c) 2024, PH-Tools and bldgtyp, llc <phtools@bldgtyp.com> 
# Honeybee-REVIVE is free software; you can redistribute it and/or modify 
# it under the terms of the GNU General Public License as published 
# by the Free Software Foundation; either version 3 of the License, 
# or (at your option) any later version. 
# 
# Honeybee-REVIVE is distributed in the hope that it will be useful,
# but WITHOUT ANY WARRANTY; without even the implied warranty of 
# MERCHANTABILITY or FITNESS FOR A PARTICULAR PURPOSE. See the 
# GNU General Public License for more details.
# 
# For a copy of the GNU General Public License
# see <https://github.com/PH-Tools/honeybee_revive/blob/main/LICENSE>.
# 
# @license GPL-3.0+ <http://spdx.org/licenses/GPL-3.0+>
#
"""
Create a new Phius-REVIVE CO2 Reduction Measure which can be applied to a
Honeybee Model. Note that a Honeybee Model can have several measures applied.
-
EM October 1, 2024
    Args:
        _name: (str) The name to give to the CO2-Reduction-Measure

        _measure_type: (CO2ReductionMeasureType) Input either:
            "1-PERFORMANCE"
            "2-NON_PERFORMANCE"
            
        _year: (int) The year

        _cost: (float) The cost of the measure.

        _kg_CO2: (float) The KG of CO2e reduced by the measure.

        _country_name: (str) The name of the country.

        _labor_fraction: (float) The percentage of the measure which is 
            related to labor, as opposed to material.

    Returns:
        measure_: (CO2ReductionMeasure) The new CO2-Reduction-Measure which can 
            be added to a Honeybee-Model.
"""

import scriptcontext as sc
import Rhino as rh
import rhinoscriptsyntax as rs
import ghpythonlib.components as ghc
import Grasshopper as gh

try:
    from ph_gh_component_io import gh_io
except ImportError as e:
    raise ImportError('\nFailed to import ph_gh_component_io:\n\t{}'.format(e))

try:
    from honeybee_revive_rhino import gh_compo_io
except ImportError as e:
    raise ImportError('\nFailed to import honeybee_revive_rhino:\n\t{}'.format(e))


# ------------------------------------------------------------------------------
import honeybee_revive_rhino._component_info_
reload(honeybee_revive_rhino._component_info_)
ghenv.Component.Name = "HB-REVIVE - Create CO2 Reduction Measure"
DEV = honeybee_revive_rhino._component_info_.set_component_params(ghenv, dev=False)
if DEV:
    from honeybee_revive_rhino.gh_compo_io.model import create_CO2_measure as gh_compo_io
    reload(gh_compo_io)

# ------------------------------------------------------------------------------
# -- GH Interface
IGH = gh_io.IGH( ghdoc, ghenv, sc, rh, rs, ghc, gh )

# ------------------------------------------------------------------------------
gh_compo_interface = gh_compo_io.GHCompo_CreateCO2ReductionMeasure(
        IGH,
        _name,
        _measure_type,
        _year,
        _cost,
        _kg_CO2,
        _country_name,
        _labor_fraction,
)
measure_ = gh_compo_interface.run()
print(measure_)
# ---------- end create_co2_reduction_measure ----------
add_co2_reduction_measures_to_model = HBREVIVEAddCO2ReductionMeasuresToModel(
    measures=flatten([load_revive_co2_measures_from_standards.measures, create_co2_reduction_measure.measure]),
    model=model.model)  # -> out, model; inputs measures: list
# ---------- add_co2_reduction_measures_to_model: Python ----------
#
# Honeybee-REVIVE: A Plugin for calculating Phius REVIVE using LadybugTools Honeybee-Energy Models
# 
# This component is part of the PH-Tools toolkit <https://github.com/PH-Tools>.
# 
# Copyright (c) 2024, PH-Tools and bldgtyp, llc <phtools@bldgtyp.com> 
# Honeybee-REVIVE is free software; you can redistribute it and/or modify 
# it under the terms of the GNU General Public License as published 
# by the Free Software Foundation; either version 3 of the License, 
# or (at your option) any later version. 
# 
# Honeybee-REVIVE is distributed in the hope that it will be useful,
# but WITHOUT ANY WARRANTY; without even the implied warranty of 
# MERCHANTABILITY or FITNESS FOR A PARTICULAR PURPOSE. See the 
# GNU General Public License for more details.
# 
# For a copy of the GNU General Public License
# see <https://github.com/PH-Tools/honeybee_revive/blob/main/LICENSE>.
# 
# @license GPL-3.0+ <http://spdx.org/licenses/GPL-3.0+>
#
"""
Add one or more Phius-REVIVE CO2-Reduction-Measures to a Honeybee-Model.
-
EM October 1, 2024
    Args:
        _measures: (list[Measures]) A list of all of the Phius-REVIVE 
            CO2-Reduction-Measures that you would like to add to the Honeybee-Model.
            
        _model: (Model) The Honeybee Model which you would like to add the 
            Phius-REVIVE CO2-Reduction-Measures to.

    Returns:
        model_: (Model) The Honeybee Model with the Phius-REVIVE 
            CO2-Reduction-Measures added to it.
"""

import scriptcontext as sc
import Rhino as rh
import rhinoscriptsyntax as rs
import ghpythonlib.components as ghc
import Grasshopper as gh

try:
    from ph_gh_component_io import gh_io
except ImportError as e:
    raise ImportError('\nFailed to import ph_gh_component_io:\n\t{}'.format(e))

try:
    from honeybee_revive_rhino import gh_compo_io
except ImportError as e:
    raise ImportError('\nFailed to import honeybee_revive_rhino:\n\t{}'.format(e))


# ------------------------------------------------------------------------------
import honeybee_revive_rhino._component_info_
reload(honeybee_revive_rhino._component_info_)
ghenv.Component.Name = "HB-REVIVE - Add CO2 Reduction Measures to Model"
DEV = honeybee_revive_rhino._component_info_.set_component_params(ghenv, dev=False)
if DEV:
    from honeybee_revive_rhino.gh_compo_io.model import add_CO2_measures_to_model as gh_compo_io
    reload(gh_compo_io)
    
# ------------------------------------------------------------------------------
# -- GH Interface
IGH = gh_io.IGH( ghdoc, ghenv, sc, rh, rs, ghc, gh )

# ------------------------------------------------------------------------------
gh_compo_interface = gh_compo_io.GHCompo_AddCO2ReductionMeasuresToModel(
        IGH,
        _measures,
        _model,
)
model_ = gh_compo_interface.run()
if model_: print(model_.properties.revive.co2_measures)
# ---------- end add_co2_reduction_measures_to_model ----------

# ----
# REVIVE | Config.
hb_revive_grid_regions = HBREVIVEGridRegions({"AZNMc | WECC Southwest": "AZNMc", "CAMXc | WECC California": "CAMXc", "ERCTc | ERCOT All": "ERCTc", "FRCCc | FRCC All": "FRCCc", "MROEc | MRO East": "MROEc", "MROWc | MRO West": "MROWc", "NEWEc | NPCC New England": "NEWEc", "NWPPc | WECC Northwest": "NWPPc", "NYSTc | New York State": "NYSTc", "RFCEc | RFC East": "RFCEc", "RFCMc | RFC Michigan": "RFCMc", "RFCWc | RFC West": "RFCWc", "RMPAc | WECC Rockies": "RMPAc", "SPNOc | SPP North": "SPNOc", "SPSOc | SPP South": "SPSOc", "SRMVc | SERC Mississippi Valley": "SRMVc", "SRMWc | SERC Midwest": "SRMWc", "SRSOc | SERC South": "SRSOc", "SRTVc | SERC Tennessee Valley": "SRTVc", "SRVCc | SERC Virginia/Carolina": "SRVCc"}, selected="SPNOc | SPP North")
hb_revive_country = HBREVIVECountry({"CANADA", "CHINA", "FRANCE", "GERMANY", "INDIA", "IRELAND", "ITALY", "JAPAN", "SOUTH KOREA", "MALAYSIA", "MEXICO", "SWITZERLAND", "TAIWAN", "UNITED KINGDOM", "USA", "VIETNAM"}, selected="USA")
set_model_properties = HBREVIVESetModelProperties(
    country_name=hb_revive_country,
    cambium_grid_region=hb_revive_grid_regions,
    hb_model=add_co2_reduction_measures_to_model.model)  # -> out, hb_model; inputs analysis_duration: Int32
# ---------- set_model_properties: Python ----------
#
# Honeybee-REVIVE: A Plugin for calculating Phius REVIVE using LadybugTools Honeybee-Energy Models
# 
# This component is part of the PH-Tools toolkit <https://github.com/PH-Tools>.
# 
# Copyright (c) 2024, PH-Tools and bldgtyp, llc <phtools@bldgtyp.com> 
# Honeybee-REVIVE is free software; you can redistribute it and/or modify 
# it under the terms of the GNU General Public License as published 
# by the Free Software Foundation; either version 3 of the License, 
# or (at your option) any later version. 
# 
# Honeybee-REVIVE is distributed in the hope that it will be useful,
# but WITHOUT ANY WARRANTY; without even the implied warranty of 
# MERCHANTABILITY or FITNESS FOR A PARTICULAR PURPOSE. See the 
# GNU General Public License for more details.
# 
# For a copy of the GNU General Public License
# see <https://github.com/PH-Tools/honeybee_revive/blob/main/LICENSE>.
# 
# @license GPL-3.0+ <http://spdx.org/licenses/GPL-3.0+>
#
"""
Set the Phius-REVIVE ADORB calculation parameters for the Honeybee-Model.
-
EM October 1, 2024
    Args:
        _country_name: (str) The name of the Country the model is located in.

        _cambium_grid_region: (str) Pass in either the name of the Cambium Grid-Region you 
            would like to use (ie: 'AZNMc', etc..) or the filepath to a Cambium Grid-Region
            JSON file that you would like to use for the REVIVE ADORB analysis.
            
        _analysis_duration: (int) The number of years to run the ADORB analysis for.

        _envelope_labor_cost_fraction: (float) The percentage of the envelope cost
            which is related to labor, as opposed to materials.

        _hb_model: (Model) The Honeybee Model to set the REVIVE properties on.

    Returns:
        hb_model_: (Model) The Honeybee Model with the REVIVE properties set.
"""

import scriptcontext as sc
import Rhino as rh
import rhinoscriptsyntax as rs
import ghpythonlib.components as ghc
import Grasshopper as gh

try:
    from ph_gh_component_io import gh_io
except ImportError as e:
    raise ImportError('\nFailed to import ph_gh_component_io:\n\t{}'.format(e))

try:
    from honeybee_revive_rhino import gh_compo_io
except ImportError as e:
    raise ImportError('\nFailed to import honeybee_revive_rhino:\n\t{}'.format(e))


# ------------------------------------------------------------------------------
import honeybee_revive_rhino._component_info_
reload(honeybee_revive_rhino._component_info_)
ghenv.Component.Name = "HB-REVIVE - Set Model Properties"
DEV = honeybee_revive_rhino._component_info_.set_component_params(ghenv, dev=False)
if DEV:
    from honeybee_revive_rhino.gh_compo_io.model import set_model_properties as gh_compo_io
    reload(gh_compo_io)
    
# ------------------------------------------------------------------------------
# -- GH Interface
IGH = gh_io.IGH( ghdoc, ghenv, sc, rh, rs, ghc, gh )

# ------------------------------------------------------------------------------
gh_compo_interface = gh_compo_io.GHCompo_SetModelProperties(
        IGH,
        _country_name,
        _cambium_grid_region,
        _analysis_duration,
        _envelope_labor_cost_fraction,
        _hb_model,
)
hb_model_ = gh_compo_interface.run()
print hb_model_
# ---------- end set_model_properties ----------

boolean_toggle_2 = BooleanToggle(True)
simoutput = HBSimulationOutput(
    zone_energy_use=boolean_toggle_2,
    system_energy_use=boolean_toggle_2,
    gains_and_losses=boolean_toggle_2,
    comfort_metrics=boolean_toggle_2)  # -> out, sim_output; plug-in component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

# ---- group: Save Folder
data = Data(hb_rv_save_folder)

# ----
# Run ADORB Simulation
set_adorb_simulation_output_variables = HBREVIVESetADORBSimulationOutputVariables(base_sim_output=simoutput.sim_output)  # -> out, sim_output
# ---------- set_adorb_simulation_output_variables: Python ----------
#
# Honeybee-REVIVE: A Plugin for calculating Phius REVIVE using LadybugTools Honeybee-Energy Models
# 
# This component is part of the PH-Tools toolkit <https://github.com/PH-Tools>.
# 
# Copyright (c) 2024, PH-Tools and bldgtyp, llc <phtools@bldgtyp.com> 
# Honeybee-REVIVE is free software; you can redistribute it and/or modify 
# it under the terms of the GNU General Public License as published 
# by the Free Software Foundation; either version 3 of the License, 
# or (at your option) any later version. 
# 
# Honeybee-REVIVE is distributed in the hope that it will be useful,
# but WITHOUT ANY WARRANTY; without even the implied warranty of 
# MERCHANTABILITY or FITNESS FOR A PARTICULAR PURPOSE. See the 
# GNU General Public License for more details.
# 
# For a copy of the GNU General Public License
# see <https://github.com/PH-Tools/honeybee_revive/blob/main/LICENSE>.
# 
# @license GPL-3.0+ <http://spdx.org/licenses/GPL-3.0+>
#
"""
Setup the PH-REVIVE ADORB Simualtion Output variables.
-
EM October 13, 2024
    Args:
        base_sim_output_: An optional Honeybee-Energy simulation output object to 
            serve as the starting point for the sim_output object returned by 
            this component. All of the required "REVIVE' output names will simply 
            be added to this initial starting object.
    Returns:
        sim_output: A SimulationOutput object that can be connected to the
            "HB Simulation Parameter" component in order to specify which
            types of outputs should be written from EnergyPlus. 
"""

import scriptcontext as sc
import Rhino as rh
import rhinoscriptsyntax as rs
import ghpythonlib.components as ghc
import Grasshopper as gh

try:
    from ph_gh_component_io import gh_io
except ImportError as e:
    raise ImportError('\nFailed to import ph_gh_component_io:\n\t{}'.format(e))

try:
    from honeybee_revive_rhino import gh_compo_io
except ImportError as e:
    raise ImportError('\nFailed to import honeybee_revive_rhino:\n\t{}'.format(e))


# ------------------------------------------------------------------------------
import honeybee_revive_rhino._component_info_
reload(honeybee_revive_rhino._component_info_)
ghenv.Component.Name = "HB-REVIVE - Set ADORB Simulation Output Variables"
DEV = honeybee_revive_rhino._component_info_.set_component_params(ghenv, dev=False)
if DEV:
    from honeybee_revive_rhino.gh_compo_io.adorb import set_ADORB_output_variables as gh_compo_io
    reload(gh_compo_io)
    

# ------------------------------------------------------------------------------
# -- GH Interface
IGH = gh_io.IGH( ghdoc, ghenv, sc, rh, rs, ghc, gh )

# ------------------------------------------------------------------------------
gh_compo_interface = gh_compo_io.GHCompo_SetADORBSimulationOutputVariables(
        IGH,
        base_sim_output_,
)
sim_output_ = gh_compo_interface.run()
# ---------- end set_adorb_simulation_output_variables ----------
simpar = HBSimulationParameter(output=set_adorb_simulation_output_variables.sim_output, timestep=6)  # -> sim_par; plug-in component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
value_list_2 = ValueList({"Rochester, MN": 1, "NYC, NY": 2, "State College, PA": 3}, selected="NYC, NY")
ghpython_script_4 = GhPythonScript(weather_folder=weather_save_folder_2, weather=value_list_2)  # -> out, epw
# ---------- ghpython_script_4: Python ----------
import os

if _weather == 1:
    epw_ = os.path.join(
        _weather_folder,
        "USA_MN_Rochester.Intl.AP.726440_TMY3",
        "USA_MN_Rochester.Intl.AP.726440_TMY3.epw"
    )
elif _weather == 2:
    epw_ = os.path.join(
        _weather_folder,
        "USA_NY_New.York-J.F.Kennedy.Intl.AP.744860_TMY3",
        "USA_NY_New.York-J.F.Kennedy.Intl.AP.744860_TMY3.epw"
    )
elif _weather == 3:
    epw_ = os.path.join(
        _weather_folder,
        "USA_PA_State.College-Penn.State.University.725128_TMY3", 
        "USA_PA_State.College-Penn.State.University.725128_TMY3.epw"
    )
else:
    epw_ = None
# ---------- end ghpython_script_4 ----------
run = BooleanToggle(False)
modeltoosm = HBModelToOSM(model=set_model_properties.hb_model, epw_file=ghpython_script_4.epw, sim_par=simpar, folder=data, write=run, run=run)  # -> out, jsons, osw, osm, idf, sql, zsz, rdd, html; plug-in component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

# ----
# Run Phius GUI IDF Simulation
panel_5 = Panel("test_full_GUI_outputs_M_10W-20S_StateCollegePA_BASE_NV_BA.idf")
ghpython_script_5 = GhPythonScript(hb_output=set_adorb_simulation_output_variables.sim_output)  # -> out, add_str
# ---------- ghpython_script_5: Python ----------
idf_str = _hb_output.to_idf()

variable_list = idf_str[1]

add_str_ = []
add_str_.append("OutputControl:Table:Style, CommaAndHTML;")
add_str_.extend(
    [_.replace("*", "").strip().replace("/n", "") for _ in idf_str[1]]
)
add_str_.extend(idf_str[2:])

add_str_ = "\n".join(add_str_)
# ---------- end ghpython_script_5 ----------
ghpython_script_6 = GhPythonScript(folder=hb_rv_save_folder_2, file=panel_5)  # -> out, file
# ---------- ghpython_script_6: Python ----------
import os
file_ = os.path.join(_folder, _file)
# ---------- end ghpython_script_6 ----------
run_2 = BooleanToggle(False)
runidf = HBRunIDF(idf=ghpython_script_6.file, epw_file=ghpython_script_4.epw, add_str=ghpython_script_5.add_str, run=run_2)  # -> out, sql, zsz, rdd, html; plug-in component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

material = Panel("""  MATERIAL,
    EPS 2in,                 !- Name
    MediumSmooth,            !- Roughness
    0.0508,                  !- Thickness {m}
    0.02884,                 !- Conductivity {W/m-K}
    29,                      !- Density {kg/m3}
    1210,                    !- Specific Heat {J/kg-K}
    0.9,                     !- Thermal Absorptance
    0.7,                     !- Solar Absorptance
    0.7;                     !- Visible Absorptance""")
foundation_kiva = Panel("""FOUNDATION:KIVA,
    Slab Details,             !- Name
    ,                         !- Initial Indoor Air Temperature
    ,                         !- Interior Horizontal Insulation Material Name
    0,                        !- Interior Horizontal Insulation Depth
    ,                         !- Interior Horizontal Insulation Width
    ,                         !- Interior Vertical Insulation Material Name
    ,                         !- Interior Vertical Insulation Depth
    ,                         !- Exterior Horizontal Insulation Material Name
    ,                         !- Exterior Horizontal Insulation Depth
    0,                        !- Exterior Horizontal Insulation Width
    EPS 2in,                  !- Exterior Vertical Insulation Material Name
    0.0003048,                !- Exterior Vertical Insulation Depth
    0.2,                      !- Wall Height Above Grade
    0,                        !- Wall Depth Below Slab
    ,                         !- Footing Wall Construction Name
    ,                         !- Footing Material Name
    0.4;                      !- Footing Depth
FOUNDATION:KIVA,
    Crawlspace Details,       !- Name
    ,                         !- Initial Indoor Air Temperature
    ,                         !- Interior Horizontal Insulation Material Name
    0,                        !- Interior Horizontal Insulation Depth
    ,                         !- Interior Horizontal Insulation Width
    ,                         !- Interior Vertical Insulation Material Name
    ,                         !- Interior Vertical Insulation Depth
    ,                         !- Exterior Horizontal Insulation Material Name
    ,                         !- Exterior Horizontal Insulation Depth
    0,                        !- Exterior Horizontal Insulation Width
    EPS 2in,                  !- Exterior Vertical Insulation Material Name
    0.0003048,                !- Exterior Vertical Insulation Depth
    0.2,                      !- Wall Height Above Grade
    0,                        !- Wall Depth Below Slab
    ,                         !- Footing Wall Construction Name
    ,                         !- Footing Material Name
    0.4;                      !- Footing Depth
FOUNDATION:KIVA,
    Basement Details,         !- Name
    ,                         !- Initial Indoor Air Temperature
    ,                         !- Interior Horizontal Insulation Material Name
    0,                        !- Interior Horizontal Insulation Depth
    ,                         !- Interior Horizontal Insulation Width
    ,                         !- Interior Vertical Insulation Material Name
    ,                         !- Interior Vertical Insulation Depth
    ,                         !- Exterior Horizontal Insulation Material Name
    ,                         !- Exterior Horizontal Insulation Depth
    0,                        !- Exterior Horizontal Insulation Width
    EPS 2in,                  !- Exterior Vertical Insulation Material Name
    0.0003048,                !- Exterior Vertical Insulation Depth
    0.2,                      !- Wall Height Above Grade
    0,                        !- Wall Depth Below Slab
    ,                         !- Footing Wall Construction Name
    ,                         !- Footing Material Name
    0.4;                      !- Footing Depth""")
surface_property = Panel("""SURFACEPROPERTY:EXPOSEDFOUNDATIONPERIMETER,
    Slab,                     !- Surface Name
    TotalExposedPerimeter,    !- Exposed Perimeter Calculation Method
    12.192,                   !- Total Exposed Perimeter
    1,                        !- Exposed Perimeter Fraction
    Yes;                      !- Surface Segment 1 Exposed
SURFACEPROPERTY:EXPOSEDFOUNDATIONPERIMETER,
    Crawlspace,               !- Surface Name
    TotalExposedPerimeter,    !- Exposed Perimeter Calculation Method
    19.812,                   !- Total Exposed Perimeter
    1,                        !- Exposed Perimeter Fraction
    Yes;                      !- Surface Segment 1 Exposed
SURFACEPROPERTY:EXPOSEDFOUNDATIONPERIMETER,
    Basement,                 !- Surface Name
    TotalExposedPerimeter,    !- Exposed Perimeter Calculation Method
    42.443400000000004,       !- Total Exposed Perimeter
    1,                        !- Exposed Perimeter Fraction
    Yes;                      !- Surface Segment 1 Exposed""")
merge_3 = Merge(Data1=material, Data2=foundation_kiva, Data3=surface_property)

data_dam = DataDam(DataDataA=runidf.sql, BufferDelay=10000000, BufferMode=0)

# ----
# Add Kiva Objects to the IDF
ghpython_script_7 = GhPythonScript(idf=modeltoosm.idf, add_str=merge_3)  # -> out, idf; inputs add_str: list
# ---------- ghpython_script_7: Python ----------
import os

# This is jsut simple brute force script to test. 
# Do not use this for anything real.

if _idf:
    # --------------------------------------------------------------------------------
    # -- Read in the IDF file as text
    with open(_idf, "r") as idf_file:
        lines = idf_file.readlines()
    

    # --------------------------------------------------------------------------------
    # -- MODIFY THE SURFACE BCs

    # -- Find the starting lines
    for i, line in enumerate(lines):
        if "  568FE7," in line:
            wall_568FE7 = i
        elif "  45825F," in line:
            wall_45825F = i
        elif "  64DDB4," in line:
            wall_64DDB4 = i
        elif "  1312C0," in line:
            wall_1312C0 = i
        elif "  Slab," in line:
            slab = i
            print i
        elif "  Basement, " in line:
            basement = i
        elif "  Crawlspace," in line:
            crawlspace = i


    # -- Change the IDF Text
    lines[wall_568FE7+5] = "  Foundation,       !- Outside Boundary Condition\n"
    lines[wall_568FE7+6] = "  Basement Details, !- Outside Boundary Condition Object\n"

    lines[wall_45825F+5] = "  Foundation,       !- Outside Boundary Condition\n"
    lines[wall_45825F+6] = "  Basement Details, !- Outside Boundary Condition Object\n"

    lines[wall_64DDB4+5] = "  Foundation,       !- Outside Boundary Condition\n"
    lines[wall_64DDB4+6] = "  Basement Details, !- Outside Boundary Condition Object\n"

    lines[wall_1312C0+5] = "  Foundation,       !- Outside Boundary Condition\n"
    lines[wall_1312C0+6] = "  Basement Details, !- Outside Boundary Condition Object\n"

    lines[slab+5] = "  Foundation,       !- Outside Boundary Condition\n"
    lines[slab+6] = "  Slab Details,     !- Outside Boundary Condition Object\n"

    lines[basement+5] = "  Foundation,       !- Outside Boundary Condition\n"
    lines[basement+6] = "  Basement Details, !- Outside Boundary Condition Object\n"

    lines[crawlspace+5] = "  Foundation,       !- Outside Boundary Condition\n"
    lines[crawlspace+6] = "  Crawlspace Details,!- Outside Boundary Condition Object\n"


    # --------------------------------------------------------------------------------
    # -- Write a new IDF file with the modified object
    new_idf_file_path = os.path.join(os.path.dirname(_idf), "idf_kiva.idf")
    with open(new_idf_file_path, "w") as new_idf_file:
        for line in lines:
            new_idf_file.write(line)
        
        for add_line in _add_str:
            new_idf_file.write(add_line + "\n")

    idf_ = new_idf_file_path
# ---------- end ghpython_script_7 ----------
runidf_2 = HBRunIDF(idf=ghpython_script_7.idf, epw_file=ghpython_script_4.epw, run=Toggle(True))  # -> out, sql, zsz, rdd, html; plug-in component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

data_dam_2 = DataDam(DataDataA=runidf_2.sql, BufferDelay=10000000, BufferMode=0)

# ----
# Calculate ADORB Cost
run_3 = BooleanToggle(False)  # disabled
calculate_adorb_costs = HBREVIVECalculateADORBCosts(folder=data, sql_path=data_dam_2, hb_model=set_model_properties.hb_model, run=run_3)  # -> out, ADORB_costs, yearly_csv_results_file, cumulative_csv_results_file, tables; disabled
# ---------- calculate_adorb_costs: Python ----------
#
# Honeybee-REVIVE: A Plugin for calculating Phius REVIVE using LadybugTools Honeybee-Energy Models
# 
# This component is part of the PH-Tools toolkit <https://github.com/PH-Tools>.
# 
# Copyright (c) 2024, PH-Tools and bldgtyp, llc <phtools@bldgtyp.com> 
# Honeybee-REVIVE is free software; you can redistribute it and/or modify 
# it under the terms of the GNU General Public License as published 
# by the Free Software Foundation; either version 3 of the License, 
# or (at your option) any later version. 
# 
# Honeybee-REVIVE is distributed in the hope that it will be useful,
# but WITHOUT ANY WARRANTY; without even the implied warranty of 
# MERCHANTABILITY or FITNESS FOR A PARTICULAR PURPOSE. See the 
# GNU General Public License for more details.
# 
# For a copy of the GNU General Public License
# see <https://github.com/PH-Tools/honeybee_revive/blob/main/LICENSE>.
# 
# @license GPL-3.0+ <http://spdx.org/licenses/GPL-3.0+>
#
"""
Calculate the Phius-REVIVE ADORB costs for the Honeybee-Model.
-
EM November 11, 2024
    Args:

        _name_: (str) An optional variant name to be used for all of the output 
            files. If none is passed, will use the Model's display_name

        _folder_: (str) An optional path to the folder you would like to save
            the output files to. If none is passed, will use the default Honeybee
            simulation path:
            - MacOS > ./Users/{you}/simulatiion/...
            - Windows > someplace...

        _sql_path: (str) The path to the EnergyPlus results SQL file generated by Honeybee-Energy.

        _hb_model: (Model) The Honeybee-Model to calculate the Phius REVIVE ADORB Costs for.
        
        _run: (bool) Set to True to run the calculation.
            
    Returns:
        ADORB_Costs_: .....

        yearly_csv_results_file_: That path to the output CSV file with the full ADORB cost breakdown.

        tables_: The path to the output folder with the detailed table-views from the 
            ADORB calculation.
"""

import scriptcontext as sc
import Rhino as rh
import rhinoscriptsyntax as rs
import ghpythonlib.components as ghc
import Grasshopper as gh

try:
    from ph_gh_component_io import gh_io
except ImportError as e:
    raise ImportError('\nFailed to import ph_gh_component_io:\n\t{}'.format(e))

try:
    from honeybee_revive_rhino import gh_compo_io
except ImportError as e:
    raise ImportError('\nFailed to import honeybee_revive_rhino:\n\t{}'.format(e))


# ------------------------------------------------------------------------------
import honeybee_revive_rhino._component_info_
reload(honeybee_revive_rhino._component_info_)
ghenv.Component.Name = "HB-REVIVE - Calculate ADORB Costs"
DEV = honeybee_revive_rhino._component_info_.set_component_params(ghenv, dev="241111")
if DEV:
    from honeybee_revive_rhino.gh_compo_io.adorb import calc_ADORB_costs as gh_compo_io
    reload(gh_compo_io)
    

# ------------------------------------------------------------------------------
# -- GH Interface
IGH = gh_io.IGH( ghdoc, ghenv, sc, rh, rs, ghc, gh )

# ------------------------------------------------------------------------------
gh_compo_interface = gh_compo_io.GHCompo_CalculateADORBCost(
        DEV,
        IGH,
        _name_, 
        _folder_,
        _sql_path,
        _hb_model,
        _run,
)
yearly_csv_results_file_, cumulative_csv_results_file_, tables_ = gh_compo_interface.run()
# ---------- end calculate_adorb_costs ----------
panel_6 = Panel(calculate_adorb_costs.out)  # disabled
panel_7 = Panel(calculate_adorb_costs.tables)  # disabled
panel_8 = Panel(calculate_adorb_costs.yearly_csv_results_file)  # disabled

generate_adorb_output_graphs = HBREVIVEGenerateADORBOutputGraphs(adorb_costs_csv=calculate_adorb_costs.cumulative_csv_results_file, folder=data)  # -> out, output; disabled
# ---------- generate_adorb_output_graphs: Python ----------
#
# Honeybee-REVIVE: A Plugin for calculating Phius REVIVE using LadybugTools Honeybee-Energy Models
# 
# This component is part of the PH-Tools toolkit <https://github.com/PH-Tools>.
# 
# Copyright (c) 2024, PH-Tools and bldgtyp, llc <phtools@bldgtyp.com> 
# Honeybee-REVIVE is free software; you can redistribute it and/or modify 
# it under the terms of the GNU General Public License as published 
# by the Free Software Foundation; either version 3 of the License, 
# or (at your option) any later version. 
# 
# Honeybee-REVIVE is distributed in the hope that it will be useful,
# but WITHOUT ANY WARRANTY; without even the implied warranty of 
# MERCHANTABILITY or FITNESS FOR A PARTICULAR PURPOSE. See the 
# GNU General Public License for more details.
# 
# For a copy of the GNU General Public License
# see <https://github.com/PH-Tools/honeybee_revive/blob/main/LICENSE>.
# 
# @license GPL-3.0+ <http://spdx.org/licenses/GPL-3.0+>
#
"""
............
-
EM November 11, 2024
    Args:
        _folder_: (Optional) An optional path to a folder to save the graphs 
            to. If none is provided, the default Ladbybug Tools folder will be 
            used as the save folder.

    Returns:       
        output_: The path to the output files.
"""

import scriptcontext as sc
import Rhino as rh
import rhinoscriptsyntax as rs
import ghpythonlib.components as ghc
import Grasshopper as gh

try:
    from ph_gh_component_io import gh_io
except ImportError as e:
    raise ImportError('\nFailed to import ph_gh_component_io:\n\t{}'.format(e))

try:
    from honeybee_revive_rhino import gh_compo_io
except ImportError as e:
    raise ImportError('\nFailed to import honeybee_revive_rhino:\n\t{}'.format(e))


# ------------------------------------------------------------------------------
import honeybee_revive_rhino._component_info_
reload(honeybee_revive_rhino._component_info_)
ghenv.Component.Name = "HB-REVIVE - Generate ADORB Output Graphs"
DEV = honeybee_revive_rhino._component_info_.set_component_params(ghenv, dev="241111")
if DEV:
    from honeybee_revive_rhino.gh_compo_io.adorb import generate_graphs as gh_compo_io
    reload(gh_compo_io)
    

# ------------------------------------------------------------------------------
# -- GH Interface
IGH = gh_io.IGH( ghdoc, ghenv, sc, rh, rs, ghc, gh )

# ------------------------------------------------------------------------------
gh_compo_interface = gh_compo_io.GHCompo_GenerateADORBGraphs(
        False,
        IGH,
        _adorb_costs_csv,
        _folder_,
)
output_ = gh_compo_interface.run()
# ---------- end generate_adorb_output_graphs ----------
panel_9 = Panel(generate_adorb_output_graphs.out)  # disabled
panel_10 = Panel(generate_adorb_output_graphs.output)  # disabled

panel_11 = Panel(calculate_adorb_costs.cumulative_csv_results_file)  # disabled
eui = HBEndUseIntensity(sql=data_dam_2)  # -> eui, eui_end_use, end_uses, gross_floor; plug-in component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
eui_2 = HBEndUseIntensity(sql=data_dam)  # -> eui, eui_end_use, end_uses, gross_floor; plug-in component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
panel_12 = Panel(eui_2.eui)
panel_13 = Panel(eui.eui)
roomenergyresult = HBReadRoomEnergyResult(sql=data_dam_2)  # -> cooling, heating, lighting, electric_equip, gas_equip, process, hot_water, fan_electric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; plug-in component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
roomenergyresult_2 = HBReadRoomEnergyResult(sql=data_dam)  # -> cooling, heating, lighting, electric_equip, gas_equip, process, hot_water, fan_electric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; plug-in component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
arithop = LBArithmeticOperation(data_1=roomenergyresult.electric_equip, data_2=roomenergyresult.process)  # -> data; plug-in component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
panel_14 = Panel(roomenergyresult.nat_vent_load)
cluster_2 = Cluster_2(data=arithop, step="0.01")
cluster_3 = Cluster_2(data=roomenergyresult_2.electric_equip, step="0.01")
polyline = PolyLine(Vertices=cluster_3, Closed=False)
polyline_2 = PolyLine(Vertices=cluster_2, Closed=False)

# ==== cluster Cluster
hb_objs = ClusterInput()
facesbytype = HBFacesByType(hb_objs=hb_objs)  # -> walls, interior_walls, roofs, ceilings, exterior_floors, interior_floors, air_walls, apertures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; plug-in component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
vizquick = HBVisualizeQuick(hb_objs=flatten(facesbytype.roofs))  # -> geo; plug-in component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
unit_z = UnitZ(Factor="0.25")
move = Move(Geometry=vizquick, Motion=unit_z)  # -> Geometry, Transform
geometry = ClusterOutput(move.Geometry)

# ==== cluster Cluster_2
data = ClusterInput()
step = ClusterInput()
xdata = LBDeconstructData(data=data)  # -> header, values; plug-in component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
list_length = ListLength(List=xdata.values)
series = Series(Start=0, Step=step, Count=list_length)
construct_point = ConstructPoint(XCoordinate=series, YCoordinate=xdata.values, ZCoordinate=0)
point = ClusterOutput(construct_point)
